# Grasshopper definition Surface Subdivision Based On Curveture.gh (Grasshopper 1.0.7)

srf = Surface(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)
surface_subdivision = GhPythonScript(
    srf=srf,
    probe_count=Slider(3, range=0..10),
    tol=Slider(0.001, range=0.001..1),
    min_edge_length=Slider(2, range=0..10),
    max_iterations=Slider(5, range=0..100))  # -> out, remainders, final_subdivisions; inputs srf: Surface, probe_count: Int32, max_iterations: Int32
# ---------- surface_subdivision: Python ----------
#Written by Ali Tabatabaie Ghomi


import rhinoscriptsyntax as rs

def test_min_edge_length(surface,min_length):
    #this function checks the edges of the surface to see if they are smaller than the minimum length. Then returns one of the 4 possible conditions.
    domain_u = rs.SurfaceDomain(surface,0)
    domain_v = rs.SurfaceDomain(surface,1)
    iso_curves = []
    
    iso_curves.append(rs.ExtractIsoCurve(surface,[domain_u[0],domain_v[0]],0))
    iso_curves.append(rs.ExtractIsoCurve(surface,[domain_u[0],domain_v[0]],1))
    iso_curves.append(rs.ExtractIsoCurve(surface,[domain_u[1],domain_v[1]],0))
    iso_curves.append(rs.ExtractIsoCurve(surface,[domain_u[1],domain_v[1]],1))
    
    small_edge = []
    for c in iso_curves:
        if rs.CurveLength(c) < min_length:
            small_edge.append(True)
        else:
            small_edge.append(False)
    if (small_edge[0] == True or small_edge[2] == True) and (small_edge[1] == False and small_edge[3] == False):
        return 1
    elif (small_edge[0] == False and small_edge[2] == False) and (small_edge[1] == True or small_edge[3] == True):
        return 2
    elif (small_edge[0] == True or small_edge[2] == True) and (small_edge[1] == True or small_edge[3] == True):
        return 3
    else:
        return 0


surfaces_to_evaluate = [srf]
final_subdivisions = []

#since the process might take too long to resolve I added the maximum iteration so the user can control if they want to stop sooner than meeting all the cretaria
iteration = 0
while len(surfaces_to_evaluate) > 0 and iteration < max_iterations:
    
    remainders = []
    iteration = iteration + 1
    new_srfs_to_evaluate = []
    
    for s in range(len(surfaces_to_evaluate)):
        surface_domain_u = rs.SurfaceDomain(surfaces_to_evaluate[s],0)
        surface_domain_v = rs.SurfaceDomain(surfaces_to_evaluate[s],1)
        
        subdiv_type = test_min_edge_length(surfaces_to_evaluate[s],min_edge_length)
        if subdiv_type == 0:
            u_probe_count = probe_count+1
            v_probe_count = probe_count+1
        elif subdiv_type == 1:
            u_probe_count = 1
            v_probe_count = probe_count+1
        elif subdiv_type == 2:
            u_probe_count = probe_count+1
            v_probe_count = 1
        else:
            final_subdivisions.append(surfaces_to_evaluate[s])
            continue
        probe_pts = []
        probe_uvs = []
        surface_curvetures = []
        
        
        
        for i in range(u_probe_count):
            u = ((surface_domain_u[1]-surface_domain_u[0]) / u_probe_count) * i + surface_domain_u[0]
            for j in range(v_probe_count):
                
                if (i == 0 and j == 0) or (i == 0 and j == v_probe_count) or (i == u_probe_count and j == 0) or (i == u_probe_count and j == v_probe_count):
                    continue
                    
                v = ((surface_domain_v[1]-surface_domain_v[0]) / v_probe_count) * j + surface_domain_v[0]
                uv = [u,v]
                
                probe_uvs.append(uv)
                surface_curveture = rs.SurfaceCurvature(surfaces_to_evaluate[s],uv)
                surface_curvetures.append(abs(surface_curveture[7]))
                
                probe_pts.append(surface_curveture[0])
        
        sorted_uvs = [x for _,x in sorted(zip(surface_curvetures,probe_uvs))]
        sorted_uvs.reverse()
        max_curveture_uv = sorted_uvs[0]
        
        
        surface_curvetures.sort()
        surface_curvetures.reverse()
        
        if surface_curvetures[0] > tol:
            if surface_domain_u[0] == max_curveture_uv[0] or surface_domain_u[1] == max_curveture_uv[0]:
                newSurface_0 = rs.TrimSurface(surfaces_to_evaluate[s],1,[surface_domain_v[0], max_curveture_uv[1]])
                newSurface_1 = rs.TrimSurface(surfaces_to_evaluate[s],1,[surface_domain_v[1], max_curveture_uv[1]])
                print [surface_domain_v[0], max_curveture_uv[1]]
                newSurface_2 = None
                newSurface_3 = None
            elif surface_domain_v[0] == max_curveture_uv[1] or surface_domain_v[1] == max_curveture_uv[1]:
                newSurface_0 = rs.TrimSurface(surfaces_to_evaluate[s],0,[surface_domain_u[0], max_curveture_uv[0]])
                newSurface_1 = rs.TrimSurface(surfaces_to_evaluate[s],0,[surface_domain_u[1], max_curveture_uv[0]])
                newSurface_2 = None
                newSurface_3 = None
            else:
                newSurface_0 = rs.TrimSurface(surfaces_to_evaluate[s],2,[[surface_domain_u[0], max_curveture_uv[0]],[surface_domain_v[0], max_curveture_uv[1]]])
                newSurface_1 = rs.TrimSurface(surfaces_to_evaluate[s],2,[[surface_domain_u[1], max_curveture_uv[0]],[surface_domain_v[0], max_curveture_uv[1]]])
                newSurface_2 = rs.TrimSurface(surfaces_to_evaluate[s],2,[[surface_domain_u[0], max_curveture_uv[0]],[surface_domain_v[1], max_curveture_uv[1]]])
                newSurface_3 = rs.TrimSurface(surfaces_to_evaluate[s],2,[[surface_domain_u[1], max_curveture_uv[0]],[surface_domain_v[1], max_curveture_uv[1]]])
            
            if newSurface_0:
                rs.ShrinkTrimmedSurface(newSurface_0)
                new_srfs_to_evaluate.append(newSurface_0)
            if newSurface_1:
                rs.ShrinkTrimmedSurface(newSurface_1)
                new_srfs_to_evaluate.append(newSurface_1)
            if newSurface_2:
                rs.ShrinkTrimmedSurface(newSurface_2)
                new_srfs_to_evaluate.append(newSurface_2)
            if newSurface_3:
                rs.ShrinkTrimmedSurface(newSurface_3)
                new_srfs_to_evaluate.append(newSurface_3)
            
            if iteration == max_iterations:
                remainders = new_srfs_to_evaluate
        else:
            final_subdivisions.append(surfaces_to_evaluate[s])
    
    surfaces_to_evaluate = new_srfs_to_evaluate
# ---------- end surface_subdivision ----------
srf_2 = Surface(surface_subdivision.remainders)
srf_3 = Surface(surface_subdivision.final_subdivisions)
merge = Merge(Data1=srf_2, Data2=srf_3)
evalsrf = EvaluateSurface(Surface=reparameterize(merge), Point=".5,.5")  # -> Point, Normal, UDirection, VDirection, graft(Frame)
edges = BrepEdges(Brep=merge)  # -> Naked, Interior, NonManifold
join = JoinCurves(Curves=edges.Naked, Preserve=False)
project = Project(Geometry=join, Plane=evalsrf.Frame)  # -> Geometry, Transform
offset = OffsetCurve(Curve=project.Geometry, Distance=expr("-x", Slider(0.03, range=0..1)), Corners=1)
amp = Amplitude(Vector=graft(evalsrf.Normal), Amplitude=Slider(0.5, range=0..1))
extr = Extrude(Base=offset, Direction=amp)
material = CreateMaterial(
    Diffuse=ColourSwatch(SwatchColor=RGB(194, 78, 78)),
    Specular=RGB(255, 255, 255),
    Emission=RGB(0, 0, 0),
    Transparency=0,
    Shine="100")
cap = CapHoles(Brep=extr)
preview = CustomPreview(Geometry=cap, Material=material)
